# Dynamo graph Failures.dyn (Dynamo 1.3.1.1736)

getWarnings = archilab.Revit.Elements.Warning.GetWarnings()
elements = archilab.Revit.Elements.Warning.Elements(getWarnings)
id = archilab.Revit.Elements.WarningElement.Id(elements)
byElementId = archilab.Revit.Selection.Select.ByElementId(id)
watch = Watch(byElementId)
