# Dynamo graph createUnits.dyn (Dynamo 2.0.2.6826)

unit_systems = UnitSystemUI(index=0)
create = archilab.Revit.Units.Units.Create(unitSystem=unit_systems)
unit_types = UnitTypeUI(index=73)
display_unit_types = DisplayUnitTypeUI(index=68)
create_2 = archilab.Revit.Units.FormatOptions.Create(displayUnitType=display_unit_types)
setFormatOptions = archilab.Revit.Units.Units.SetFormatOptions(units=create, unitType=unit_types, formatOptions=create_2)
code_block = CodeBlock { 0.5; }
format = archilab.Revit.Units.UnitUtils.Format(units=setFormatOptions, unitType=unit_types, value=code_block)
watch = Watch(format)
