# Dynamo graph isVisible.dyn (Dynamo 2.0.2.6826)

categories = Categories(index=604)
all_elements_of_category = ElementsOfCategory(Category=categories)
current = Document.Current()
activeView = Document.ActiveView(document=current)
isVisible = archilab.Revit.Elements.Elements.IsVisible(element=all_elements_of_category, view=activeView)
watch = Watch(isVisible)
element_types = ElementTypes(index=144)
all_elements_of_type = ElementsOfType(element_type=element_types)
isVisible_2 = archilab.Revit.Elements.Elements.IsVisible(element=all_elements_of_type, view=activeView)
watch_2 = Watch(isVisible_2)
