# Dynamo graph listNodes.dyn (Dynamo 2.0.1.4650)

view_type = ViewTypesUi(index=7)
dropdown_list = DropdownToListNodeModel(dropdown=view_type, Input=["AreaPlan", "CeilingPlan", "ColumnSchedule", "CostReport", "Detail", "DraftingView", "DrawingSheet", "Elevation", "EngineeringPlan", "FloorPlan", "Internal", "Legend", "LoadsReport", "PanelSchedule", "PresureLossReport", "ProjectBrowser", "Rendering", "Report", "Schedule", "Section", "SystemBrowser", "ThreeD", "Undefined", "View Template", "Walkthrough"])
list_selector = ListSelector(List=dropdown_list)
watch = Watch(list_selector)
dropdown_list_selector = DropdownListSelector(List=dropdown_list)
watch_2 = Watch(dropdown_list_selector)
wall_types = WallTypes(index=2)
get_bipparameter_name = BuiltInParamSelector(Element=wall_types, SelectedItem={Name: "Instance | URL", BipName: "ALL_MODEL_URL"})
watch_3 = Watch(get_bipparameter_name)
