# Dynamo graph revisionNumberOnSheet.dyn (Dynamo 2.0.2.6826)

# note: archi-lab.net
view_type = ViewTypesUi(index=6)
getByType = archilab.Revit.Views.Views.GetByType(viewType=view_type)
revisions = archilab.Revit.Views.Sheets.Revisions(sheet=getByType)
getRevisionNumberOnSheet = archilab.Revit.Views.Sheets.GetRevisionNumberOnSheet(sheet=getByType, revision=revisions)
watch = Watch(getRevisionNumberOnSheet)
