# Dynamo graph textNotePlus.dyn (Dynamo 1.3.0.875)

text_note_plus = TextNotePlus()
code_block = CodeBlock { {1,2,3,4,5}; }
dropdown_list_selector = DropdownListSelector(code_block)
watch = Watch(dropdown_list_selector)
text_note_plus_2 = TextNotePlus()
