# Dynamo graph units.dyn (Dynamo 2.0.2.6826)

getInternal = archilab.Revit.Units.Units.GetInternal()
unit_types = UnitTypeUI(index=73)
code_block = CodeBlock { [1, 1.25, 2.5]; }
format = archilab.Revit.Units.UnitUtils.Format(units=getInternal, unitType=unit_types, value=code_block)
watch = Watch(format)
