# Dynamo graph viewTemplates.dyn (Dynamo 2.0.1.5055)

view_templates = ViewTemplatesUi(index=1)
nonControlledTemplateParameters = archilab.Revit.Views.ViewTemplates.NonControlledTemplateParameters(viewTemplate=view_templates)
view_template_parameters = ViewTemplateParametersUi(index=24)
list_create = List.Create(item0=view_template_parameters)
boolean = BoolSelector(false)
include = archilab.Revit.Views.ViewTemplates.Include(viewTemplate=view_templates, parameters=list_create, include=boolean)
view_template_parameters_2 = ViewTemplateParametersUi(index=24)
view_template_parameters_3 = ViewTemplateParametersUi(index=26)
list_create_2 = List.Create(item0=view_template_parameters_2, item1=view_template_parameters_3)
isIncluded = archilab.Revit.Views.ViewTemplates.IsIncluded(viewTemplate=include, parameter=list_create_2)
watch = Watch(isIncluded)
getTemplateParameterIds = archilab.Revit.Views.ViewTemplates.GetTemplateParameterIds(viewTemplate=view_templates)
getParameterName = archilab.Revit.Views.ViewTemplates.GetParameterName(parameter=getTemplateParameterIds)
